# Requirement set scMobileRobotRequirements (R2022a)

## 1 [-] Endurance (Container)

### 1.1 [SYSTEM-REQ-01] Battery Capacity
The robot shall have a battery capacity sufficient for a minimum of of 10 hours of continous operation.

### 1.2 [SYSTEM-REQ-02] Battery Charge Time
The robot shall be able to charge itself to full capacity in a maximum of 2 hours.

## 2 [-] Payload and Speed (Container)

### 2.1 [SYSTEM-REQ-03] Maximum Payload
The robot shall support a maximum payload of 500 kg.

### 2.2 [SYSTEM-REQ-04] Nominal Operating Speed with Payload
The robot shall be able to operate at 1 m/s with a full payload.

### 2.3 [SYSTEM-REQ-13] Motor Type
The robot shall use brushless DC motors for propulsion and payload handling.

## 3 [-] Autonomy (Container)

### 3.1 [SYSTEM-REQ-06] Path Generation
The robot shall automatically generate a path from its current position to a newly specified position.

### 3.2 [SYSTEM-REQ-12] Path Gen Time
The robot shall generate a path in less than 0.3 seconds.

### 3.3 [SYSTEM-REQ-07] Path Following
The robot shall follow a generated path with a maximum deviation of ±0.1 m.

### 3.4 [SYSTEM-REQ-08] Collision Avoidance
The robot shall be able to avoid collisions with stationary and mobile objects when operating at maximum speed.

### 3.5 [SYSTEM-REQ-09] Charging Station Location
The robot shall be able to locate its own charging station and set it as a target

### 3.6 [SYSTEM-REQ-05] Self-Localization
The robot must be able to determine its current position within 0.1 m.

## 4 [-] Life Expectancy (Container)

### 4.1 [SYSTEM-REQ-09] Battery Life
The robot battery shall be able to operate without failing for 2 years.

### 4.2 [SYSTEM-REQ-10] Sensor Life (Container)
The robot sensors shall be able to operate without failing for 2 years.

### 4.3 [SYSTEM-REQ-11] Mechanical Component Life
The robot mechanical components shall have a life expectancy of 6 yrs under normal operation.