# Requirement set scMobileRobotSubsystemRequirements (R2021a)

## 1 [-] Battery
This section contains low-level battery requirements.

### 1.1 [BATTERY-REQ-01] Battery Capacity
The battery shall have a capacity of 2.5 kWh.

### 1.2 [BATTERY-REQ-02] Charging
The battery charging station shall have a minimum charging current of 3 amperes.

## 2 [-] Structure
This section contains structural requirements for the robot.

### 2.1 [STRUCT-REQ-01] Maximum Strength
The structure must support a maximum robot weight of 1650 kg.
Rationale: ((Dry Weight of 50 kg + Max Payload of 500 kg)* Safety Factor of 3)

## 3 [-] Propulsion
This section contains requirements for the robot propulsion system.

### 3.1 [MOTOR-REQ-01] Motor Power
The motor shall have a maximum power output of at least 0.2 kW.

### 3.2 [MOTOR-REQ-02] Motor Speed
The motor shall have a top speed of at least 2000 rpm.

## 4 [-] Path Generation

### 4.1 [PATH-REQ-01] Path Gen Algorithm
The path generation function shall create a path for the robot starting from the end position and working backwards to the robot's current position.

### 4.2 [PATH-REQ-02] Automatic Path Regeneration
The path generation function shall automatically generate a new path when the current path will result in an object collision.

## 5 [-] Position Determination

### 5.1 [POS-REQ-02] Kalman Filter
The position determination function shall use a kalman filter to determine the robot position.

## 6 [-] Controller

### 6.1 [CTRL-REQ-01] Controller CPU Speed
The controller shall operate at a frequency of 2 GHz.

### 6.2 [CTRL-REQ-02] Controller Memory
The controller shall have 2 GB of Random Access Memory.

### 6.3 [CTRL-REQ-03] Controller Disk Space
The controller shall have a storage capacity of 32 GB.

## 7 [-] Component Life

### 7.1 [LIFE-REQ-01] LIDAR Life Expectancy
The lidar camera shall have a minimum life expectancy of 21,900 hours.
Rationale: 20 hours per day of operation * 365 days per year * 3 years MTBF

### 7.2 [LIFE-REQ-02] RGB Camera Life Expectancy
The RGB camera shall have a minimum life expectancy of 73 hours.
Rationale: RGB camera is only used for charging station alignment so:
Approximately 2 minutes to align twice a day so 4 minutes per day total.
4 minutes per day * (1/60 hours per minute) * 365 days per year * 3 years MTBF

### 7.3 [LIFE-REQ-03] Position Encoder Life Expectancy
The position encoder shall have a minimum life expectancy of 200,000 cycles.
Rationale: [maxEncoderCyclesPerDay*daysPerYear*MTBF]

### 7.4 [LIFE-REQ-04] Motor Life
The motor shall have a minimum life expectancy of 200,000 cycles.
Rationale: [maxMotorCyclesPerDay*daysPerYear*MTBF]

### 7.5 [LIFE-REQ-05] Battery Life
The battery shall be able to withstand 1,460 full charge/discharge cycles before needing to be replaced.
Rationale: [dischargeCyclesPerDay*daysPerYear*MTBR]