# Requirement set STAKEHOLDERS (R2021b)

## 1 [ST00] Main Objective (Informational)
The system shall serve as a platform for research and development for the ASLab projects of several investigators.

## 2 [-] Modular capacity (Container)
The system shall have the capacity to be modular in order to be usable for cognitive robotics experiments.

### 2.1 [ST33] Additional Hardware (Informational)
The system shall be able to change the hardware for the experiment you want to perform.

### 2.2 [ST34] Additional Software (Informational)
The system shall be able to change the software for the experiment you want to perform.

### 2.3 [ST35] External software
The system shall accept interaction for external software.

### 2.4 [ST36] Quick Rotatory Mission
The system shall be able to switch quickly between two experiments.

## 3 [ST02] Autonomous Battery Charge (Informational)
The system shall charge itself autonomously.

## 4 [-] Autonomous Navigation (Container)
The system shall navigate autonomously in its surroundings.

### 4.1 [ST04] Position (Informational)
The system shall know its position.

### 4.2 [ST05] Velocity (Informational)
The system shall know its speed.

### 4.3 [ST20] Safety (Informational)
The system shall be careful of their surroundings due to the presence of people or animals. It shall avoid risks.

### 4.4 [ST24] Adaptability (Informational)
The system shall adapt to changes of the floor.

## 5 [-] Reliability (Container)

### 5.1 [ST11] MTBR (Informational)
The mean time before repair shall be more than 2 years.

### 5.2 [ST12] MTBF (Informational)
The mean time before failure shall be more than 12 months.

### 5.3 [ST13] Waterproof (Informational)
The system shall resist raindrop.

### 5.4 [ST14] Dustproof (Informational)
The system shall resist the ingress of dust.

### 5.5 [ST15] Impact Resistant (Informational)
The system shall be tough.

## 6 [ST16] Noise (Informational)
The system shall be silent, within the limits required by the regulations, i.e. less than a leaf blower.

## 7 [-] Communication (Container)

### 7.1 [ST17] User Interface (Informational)
The system shall have a user interface.

### 7.2 [ST18] Data Capture and Monitoring (Informational)
Users shall have the control of the system.
The system shall collect information related to different and future experiments.

### 7.3 [ST19] WIFI (Informational)
The system shall allow communication via wifi.

## 8 [-] Perception (Container)

### 8.1 [ST21] Avoid Obstacles (Informational)
The system shall include obstacle avoidance software.

### 8.2 [ST06] Incident Warning (Informational)
The system shall report if there is an incident.
Incident is to be understood as some situation that may cause damage in the robot or in the users of the robot.

### 8.3 [ST23] Stuck Detection (Informational)
The system shall detect if it becomes trapped without the need for localisation.

### 8.4 [ST29] Location Sensors (Informational)
The system shall have location sensors to achieve a very precise localization.
Rationale: Feedback from Esther Aguado

## 9 [-] Feasibility (Container)

### 9.1 [ST25] Deadlines (Informational)
The reconditioning of the robot shall spend less than 1000 h.

### 9.2 [ST26] Cost (Informational)
The cost of the components shall be lower than INGENIA SE budget.

### 9.3 [ST27] Stock (Informational)
The stock of the components shall be available.

## 10 [-] Interaction with objects (Container)

### 10.1 [ST28] Collection (Informational)
The system may collect objects from the floor.

### 10.2 [ST07] Loading Capacity (Informational)
The system shall have the capacity to carry loads.

### 10.3 [ST08] Unloading Capacity (Informational)
The system shall have the capacity to unload loads.

## 11 [ST30] Operating Time (Informational)
The system shall have a battery that operates for at least 2 h.
Rationale: Feedback from Esther Aguado

## 12 [-] Fault Injection (Container)
The system shall be able to introduce artificial injection of disturbances to create experimental fault scenarios for evaluation.

### 12.1 [ST31] Main Actuators
The system shall allow the main actuators to be disconnected through code.
Rationale: Feedback from Esther Aguado

### 12.2 [ST32] Sensors
The system shall allow the sensors to be disconnected through code.
Rationale: Feedback from Esther Aguado

## 13 [ST09] Hardware for Autonomous Vehicles (Informational)
The system shall include a state of the art SoC for automated driving.

## 14 [ST10] Reuse (Informational)
The new system shall use as many as possible of the elements from the previous system.

## 15 [ST37] UGV - UAV Collaboration (Informational)
The system should be able to cooperate with the drone in the collection of cans from the "pérgola".

## 16 [ST38] Experiment Replication
The system shall have the ability to replicate experiments.

## 17 [ST39] Documentation for Experimenters
The system shall generate documentation and procedures to be used by future experimenters.