# Requirement set SUBSYSTEM (R2021b)

## 1 [-] Perception (Container)

### 1.1 [SUB07] LIDAR
The system shall have a LIDAR.

### 1.2 [SUB08] Pulsed Sensors
The system shall have pulsed sensors.

### 1.3 [SUB09] RGBD and Infrared Camera
The system shall have a RGBD and infrared camera with a 2 DOF high precision and torque actuator for the orientation of the camera.

## 2 [-] Communication (Container)

### 2.1 [SUB03] DGPS
The system should have a radio antenna for DGPS.

### 2.2 [SUB04] GPS
The system shall include a high performance GPS.

## 3 [-] Supporting (Container)

### 3.1 [SUB05] Wireless Network
The system shall include a wireless network for communications with the wireless local network in the ASLab.

### 3.2 [SUB06] User Terminal
The system shall include a user terminal.

### 3.3 [SUB14] Information Capture
The system shall collect all important information for future experiments.

## 4 [-] Motion (Container)

### 4.1 [SUB11] Engines
The system shall have 4 Pittman motors GM9236E204.

## 5 [-] Control (Container)

### 5.1 [SUB02] Onboard Computer
The system shall include an onboard computer.

### 5.2 [SUB01] Base Platform
The system shall include the Pioneer 2-AT8 platform.

## 6 [-] Power (Container)

### 6.1 [SUB12] Battery
The system shall use 3 batteries of 12 VDC 7 Ah-h.

### 6.2 [SUB13] Power Board
The system shall have a board for controlling power to other devices.