# Requirement set SYSTEM (R2021b)

## 1 [-] Propulsion System

### 1.1 [SYS01] Maximum Speed
The system maximum speed shall be limited to 2 m/s.

### 1.2 [SYS02] Maximum Torque
The system shall have a maximum torque at least of 50 Nm, to improve Higgs 1.0.

### 1.3 [SYS03] Maximum Acceleration
The system shall accelerate 5 m/s^2 .

### 1.4 [SYS04] Power
The system shall have a power of at least 100 W.

### 1.5 [SYS26] Reliability
The propulsion system shall last for 5 years at least.

### 1.6 [SYS27] Weight
The group of elements of the propulsion system shall have a maximum mass of 2 kg.

## 2 [-] Perception System

### 2.1 [SYS05] Resolution
The system shall have a 20 Mpx camera.

### 2.2 [SYS07] Reliability
The perception system should last for 2 years.

### 2.3 [SYS08] Weight
The perception system shall have a maximum mass of 1 kg.

### 2.4 [SYS21] Avoid Obstacles
The system shall include software to avoid obstacles.

### 2.5 [SYS25] Current Sensors
The system shall have current sensors on the motors.

## 3 [-] Navigation System

### 3.1 [SYS09] Path Planning
The system shall be able to generate its own routes.

### 3.2 [SYS10] Location
The system shall be able to locate its position in real time with an accuracy of +/- 0.3 m.

### 3.3 [SYS11] Route Tracking
The system shall be able to follow the path planned with a maximum deviation of 0.4 m.

### 3.4 [SYS12] Reliability
The navigation system should last for 2 years.

### 3.5 [SYS13] Weight
The group of elements of the navigation system shall have a maximum mass of 1 kg.

### 3.6 [SYS06] Autonomy
The system shall be able to move autonomously.

## 4 [-] Energy System

### 4.1 [SYS14] Autonomy
The system shall have a battery capacity of at least 22 kWh, to improve the battery duration of the Higgs 1.0.

### 4.2 [SYS15] Weight
The energy system shall have a maximum mass of 1 kg.

### 4.3 [SYS16] Recharge time
Batteries shall be fully recharged in 2 hour.

## 5 [-] Expected Lifetime (Container)

### 5.1 [SYS17] Battery Life
The battery shall operate without failure for at least 1 year.

### 5.2 [SYS18] Sensors Life
Sensors shall operate without failure for at least 1 year.

### 5.3 [SYS19] Mechanic Life
The mechanic elements shall operate without failure for at least 1 month.

## 6 [SYS20] Maximum Payload
The system shall have the capacity to carry a maximum load of 40 kg.

## 7 [SYS22] Generated Noise
The system shall operate without exceeding 40 dB.

## 8 [-] Software (Container)

### 8.1 [SYS23] ROS2
All the systems shall be operated by ROS2.

### 8.2 [SYS24] Ignition Gazebo
All the systems shall be simulated on Ignition Gazebo by request of the stakeholders (Esther Aguado).

## 9 [SYS28] Quick Coupling Mechanism
The system shall have a quick coupling mechanism to quickly change between two experiments.